# Grasshopper definition snowflakes_sample_file.gh (Grasshopper 1.0.7)

width = Slider(0.27, range=0..1)
depth = Slider(0.7, range=0..1)
geo = Geometry(Point(-4.551260036, -1.087469212, 0))
depth_2 = Slider(0.72, range=0..1)
width_2 = Slider(0.32, range=0..1)
geo_2 = Geometry(Point(-4.551260036, -1.087469212, 0))
geo_3 = Geometry(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)
python = GhPythonScript(polyline=geo_3, iterations=Slider(6, range=0..10))  # -> out, snowflake; inputs polyline: Curve
# ---------- python: Python ----------
__author__ = "k4rm3n"
__version__ = "2021.11.23"

import rhinoscriptsyntax as rs
import Rhino as rh
import Grasshopper as gh
import ghpythonlib.treehelpers as gt 

pl = polyline
it = iterations



def koch(poly):
    lines = rs.ExplodeCurves(poly)
    newlines = []
    for line in lines:
        #endpoints and length
        stpt = rs.CurveStartPoint(line)
        endpt = rs.CurveEndPoint(line)
        dist = rs.Distance(stpt, endpt)
        #midpoints and third and two thirds
        crvdomain = rs.CurveDomain(line)
        p0 = rs.CurveParameter(line, 0.5)
        midpt = rs.EvaluateCurve(line,p0)
        p1 = rs.CurveParameter(line, 1/3)
        pt1 = rs.EvaluateCurve(line,p1)
        p2 = rs.CurveParameter(line, 2/3)
        pt2 = rs.EvaluateCurve(line,p2)
        #get normal vector
        dx = endpt[0] - stpt[0] 
        dy = endpt[1] - stpt[1] 
        dz = endpt[2] - stpt[2] 
        vector = [dy, -dx, -dz]
        #move vector
        univect = rs.VectorUnitize(vector)
        newpt = rs.MoveObject(midpt,univect*dist/3)
        #the new lines
        newln1 = rs.AddPolyline([stpt, pt1, midpt, pt2, endpt])
        newlines.append(newln1)
    return newlines


def recursive(poly, num_it, list):
    if num_it > 0:
        newpoly = koch(poly)
        num_it -=1
        recursive(newpoly, num_it, list)
        if num_it == 0:
                list.append(newpoly)
    return gt.list_to_tree(list)

ln = []

snowflake = recursive(polyline, iterations, ln)
# ---------- end python ----------
python_2 = GhPythonScript(
    point=geo,
    size=Slider(23.44, range=0..100),
    branches=Slider(6, range=0..10),
    iterations=Slider(7, range=0..10),
    width=width,
    depth=depth)  # -> out, snowflake; inputs point: Point3d, branches: Int32, iterations: Int32
# ---------- python_2: Python ----------
__author__ = "k4rm3n"
__version__ = "2021.11.23"

import rhinoscriptsyntax as rs
import Rhino as rh
import Grasshopper as gh
import ghpythonlib.treehelpers as gt 

pt = rs.AddPoint(list(point))
it = iterations
sz = size


vector = [0,sz,0]
pt2 = rs.MoveObject(pt,vector)
ln1 = []
ln1.append(rs.AddLine(point, pt2))

def polar(elem, center, number_of_rot):
    array = []
    for i in range(number_of_rot):
        angle = (360/number_of_rot)*i
        array.append(rs.RotateObject(elem, center, angle, None, True))
    return array

array = polar(ln1,point,branches)

def snowflake(lines):
    flake = []
    for line in lines:
        stpt = rs.CurveStartPoint(line)
        endpt = rs.CurveEndPoint(line)
        dist = rs.Distance(stpt, endpt)
        #midpoints and third and two thirds
        crvdomain = rs.CurveDomain(line)
        p0 = rs.CurveParameter(line, 0.5)
        midpt = rs.EvaluateCurve(line,p0)
        #get normal vector
        dx = endpt[0] - stpt[0] 
        dy = endpt[1] - stpt[1] 
        dz = endpt[2] - stpt[2] 
        vector = [dy, -dx, -dz]
        univect = rs.VectorUnitize(vector)
        param = rs.CurveParameter(line, depth)
        pt_two_thirds= rs.EvaluateCurve(line,param)
        mid1 = list(pt_two_thirds)
        middle1 = rs.AddPoint(mid1)
        mid2 = list(pt_two_thirds)
        middle2 = rs.AddPoint(mid2)
        #getlines
        newpt1 = rs.MoveObject(middle1,univect*(dist*width))
        newpt2 = rs.MoveObject(middle2,-univect*(dist*width))
        newline1 = rs.AddLine(stpt, midpt)
        newline2 = rs.AddLine(midpt, endpt)
        newline3 = rs.AddLine(midpt, middle1)
        newline4 = rs.AddLine(midpt, middle2)
        flake.append(newline1)
        flake.append(newline2)
        flake.append(newline3)
        flake.append(newline4)
    return flake




def recursive(polar, num_it, list):
    if num_it > 0:
        new_lines = snowflake(polar)
        num_it -=1
        recursive(new_lines, num_it, list)
        if num_it == 0:
                list.append(new_lines)
    return gt.list_to_tree(list)

ln = []
snowflake = recursive(array,iterations,ln)
flak = pt
# ---------- end python_2 ----------
python_3 = GhPythonScript(
    point=geo_2,
    size=Slider(36.46, range=0..100),
    branches=Slider(7, range=0..10),
    iterations=Slider(4, range=0..10),
    width=width_2,
    depth=depth_2)  # -> out, snowflake, branch; inputs branches: Int32, iterations: Int32
# ---------- python_3: Python ----------
__author__ = "k4rm3n"
__version__ = "2021.11.23"

import rhinoscriptsyntax as rs
import Rhino as rh
import Grasshopper as gh
import ghpythonlib.treehelpers as gt 

pt = rs.AddPoint(point)
it = iterations
sz = size


vector = [0,sz,0]
pt2 = rs.MoveObject(pt,vector)
ln1 = []
ln1.append(rs.AddLine(point, pt2))



def polar(elem, center, number_of_rot):
    array = []
    for i in range(number_of_rot):
        angle = (360/number_of_rot)*i
        for n in range(len(elem)):
            obj = elem[n]
            array.append(rs.RotateObject(obj, center, angle, None, True))
    return array

def snowflake(lines):
    flake = []
    for line in lines:
        stpt = rs.CurveStartPoint(line)
        endpt = rs.CurveEndPoint(line)
        dist = rs.Distance(stpt, endpt)
        #midpoints and third and two thirds
        crvdomain = rs.CurveDomain(line)
        p0 = rs.CurveParameter(line, 0.5)
        midpt = rs.EvaluateCurve(line,p0)
        #get normal vector
        dx = endpt[0] - stpt[0] 
        dy = endpt[1] - stpt[1] 
        dz = endpt[2] - stpt[2] 
        vector = [dy, -dx, -dz]
        univect = rs.VectorUnitize(vector)
        param = rs.CurveParameter(line, depth)
        pt_two_thirds= rs.EvaluateCurve(line,param)
        mid1 = list(pt_two_thirds)
        middle1 = rs.AddPoint(mid1)
        mid2 = list(pt_two_thirds)
        middle2 = rs.AddPoint(mid2)
        #getlines
        newpt1 = rs.MoveObject(middle1,univect*(dist*width))
        newpt2 = rs.MoveObject(middle2,-univect*(dist*width))
        newline1 = rs.AddLine(stpt, midpt)
        newline2 = rs.AddLine(midpt, endpt)
        newline3 = rs.AddLine(midpt, middle1)
        newline4 = rs.AddLine(midpt, middle2)
        flake.append(newline1)
        flake.append(newline2)
        flake.append(newline3)
        flake.append(newline4)
    return flake




def recursive(polar, num_it, list):
    if num_it > 0:
        new_lines = snowflake(polar)
        num_it -=1
        recursive(new_lines, num_it, list)
        if num_it == 0:
                list.append(new_lines)
    return gt.list_to_tree(list)

ln = []
branch = recursive(ln1,iterations,ln)
branch.Flatten()

list_br = gt.tree_to_list(branch)
snowflake = polar(list_br, point, branches)
# ---------- end python_3 ----------
panel = Panel(python.snowflake)
geo_4 = Geometry(python.snowflake)
geo_5 = Geometry(python_2.snowflake)
join = JoinCurves(Curves=geo_4, Preserve=False)
geo_6 = Geometry(python_3.snowflake)
